# Grasshopper definition HilbertCurving.gh (Grasshopper 1.0.7)

merge = Merge(Data1=Slider(3.1, range=0..100), Data2=Slider(77.8, range=0..100))
merge_2 = Merge(Data1=Slider(13.5, range=0..100), Data2=Slider(89.9, range=0..100))
crv = Curve(<curve referenced from the Rhino model>)
pt = Point([Point(120.2773554, 101.5225194, 0), Point(48.97591003, 86.30320507, 0), Point(77.53818492, 71.29237447, 0), Point(108.3937812, 31.26349286, 0), Point(61.27645177, 27.92775273, 0), Point(61.48493553, -10.85022633, 0)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])
python = GhPythonScript(
    crvs=crv,
    GLOBAL_SCALE=Slider(0.7, range=0.2..100),
    max_depth=Slider(8, range=0..10),
    x=Slider(9.42, range=1..10),
    y=Slider(8.6, range=1..10),
    z=Slider(6.12, range=1..10),
    height=Slider(8.49, range=1..10))  # -> out, a; inputs crvs: list of Curve
# ---------- python: Python ----------
import os
import sys

file_name = ghenv.Component.OnPingDocument().FilePath

def get_parent(path, degree = 1):
    
    parent = path
    
    for i in range(degree):
        
        parent = os.path.dirname(parent)
        
    return parent
    
path = get_parent(file_name, 3)

sys.path.append(os.path.join(path, 'src') )

from spacemapping_curve.quadtree import *
import spacemapping_curve.distance as sdf
import spacemapping_curve.hilbertcurve as hc
import spacemapping_curve.combinations as co

import Rhino.Geometry as rg
import rhinoscriptsyntax as rs

reload(hc)
reload(sdf)
reload(co)

print("SchwarzG Domain: {}".format(sdf.SchwarzG().domain ) )
print("SchwarzP Domain: {}".format(sdf.SchwarzP().domain ) )
print("SchwarzD Domain: {}".format(sdf.SchwarzD().domain ) )
print("SchwarzW Domain: {}".format(sdf.SchwarzW().domain ) )
print("SchwarzN Domain: {}".format(sdf.SchwarzN().domain ) )
print("SchwarzPW Domain: {}".format(sdf.SchwarzPW().domain ) )
print("Lindinoid Domain: {}".format(sdf.Lindinoid().domain ) )
print("PinchD Domain: {}".format(sdf.PinchD().domain ) )
print("PinchP Domain: {}".format(sdf.PinchP().domain ) )
print("PinchG Domain: {}".format(sdf.PinchG().domain ) )
print("PinchW Domain: {}".format(sdf.PinchW().domain ) )


# ==============================================================================
# get distance value
# ==============================================================================
sdf.DistanceToCurve.GLOBAL_SCALE = GLOBAL_SCALE * 5
# sdf.FuckYouBernhardFunction.GLOBAL_SCALE = GLOBAL_SCALE

# sdf.SDF.X_SCALE = x
# sdf.SDF.Y_SCALE = y
# sdf.SDF.Z_SCALE = z

# sdf.FuckYouBernhardFunction.HEIGHT = height * z

crv_distance = sdf.DistanceToCurve(crvs)

pinch_d = sdf.PinchD(x, y, z, height, GLOBAL_SCALE, 10, -.5, 14)

gyroid = sdf.Gyroid(x, y, z, height, GLOBAL_SCALE * 10.0)

# structure = hc.BooleanUnion([crv_distance, pinch_d, gyroid])
structure = co.BooleanUnion([pinch_d, gyroid])

# ==============================================================================
# Main
# ==============================================================================

a = hc.draw_hc(200, max_depth, structure)
# ---------- end python ----------
python_2 = GhPythonScript(x=merge_2, y=merge, z=pt)  # -> out, a, b; inputs x: list, y: list, z: list of Point3d
# ---------- python_2: Python ----------
import Rhino.Geometry as rg

x_int = rg.Interval(x[0], x[1])
y_int = rg.Interval(y[0], y[1])

a = rg.Rectangle3d(rg.Plane.WorldXY, x_int, y_int)

b = []

for pt in z:

    if a.Contains(pt) == rg.PointContainment.Inside:
        
        b.append(pt)
# ---------- end python_2 ----------
panel = Panel(python_2.out)
panel_2 = Panel(python.out)
