# Grasshopper definition HilbertGcode_3.gh (Grasshopper 1.0.7)

number_slider = Slider(1, range=0..1)
crv = Curve(<curve referenced from the Rhino model>)
python = GhPythonScript(crv=crv)  # -> out, a, b; inputs crv: Curve
# ---------- python: Python ----------
import sys
import rhinoscriptsyntax as rs

import Rhino.Geometry as rg

sys.path.append("/Users/jonas/Documents/reps/spacemapping_curve/src/spacemapping_curve/matplotlib_qt")

import quad_tree as qt

reload(qt)

global crv
class DistanceObject():
    
    def __init__(self):
        
        pass
        
    def get_distance(self, vec):
    
        v = rg.Point3d(vec.x, vec.y, vec.z)
        
        _, t_val = crv.ClosestPoint(v)
        pt_on_c = crv.PointAt(t_val)
        
        print(pt_on_c)
        
        return 5 - pt_on_c.DistanceTo(v) / 12.

d_f_obj=DistanceObject()
# q_obj = qt.QuadObj(qt.distance_f)
q_obj = qt.QuadObj(d_f_obj, quad_type = '3/4', last_is_quad=0)
q_obj.create()
a = rs.AddPolyline(q_obj.tuple_list())
b = q_obj.orientation_list()
# ---------- end python ----------
divide = DivideCurve(Curve=python.a, Count=1, Kinks=True)  # -> Points, Tangents, Parameters
pt = ConstructPoint(XCoordinate=number_slider, YCoordinate=number_slider, ZCoordinate=0)
move = Move(Geometry=divide.Points, Motion=pt)  # -> Geometry, Transform
tag = TextTag(Location=move.Geometry, Text=python.b)
panel = Panel(python.out)
